# Grasshopper definition bench.gh (Grasshopper 1.0.7)

crv = Curve(<curve referenced from the Rhino model>)
series = Series(Start=0, Step=Slider(150, range=0..1000), Count=Slider(5, range=0..10))
X = UnitX(Factor=series)
move = Move(Geometry=crv, Motion=X)  # -> Geometry, Transform
item = ListItem(List=move.Geometry, Index=Slider(0, range=0..100), Wrap=True)
item_2 = ListItem(List=move.Geometry, Index=Slider(2, range=0..100), Wrap=True)
item_3 = ListItem(List=move.Geometry, Index=Slider(3, range=0..100), Wrap=True)
item_4 = ListItem(List=move.Geometry, Index=Slider(1, range=0..100), Wrap=True)
item_5 = ListItem(List=move.Geometry, Index=Slider(4, range=0..100), Wrap=True)
neg = Negative(Value=Slider(14, range=0..100))
neg_2 = Negative(Value=Slider(23, range=0..100))
number_slider = Slider(100, range=0..100)
neg_3 = Negative(Value=Slider(100, range=0..100))
number_slider_2 = Slider(100, range=0..100)
neg_4 = Negative(Value=Slider(50, range=0..100))
neg_5 = Negative(Value=Slider(50, range=0..100))
Y = UnitY(Factor=neg)
Y_2 = UnitY(Factor=neg_2)
Y_3 = UnitY(Factor=neg_3)
Y_4 = UnitY(Factor=neg_4)
Y_5 = UnitY(Factor=neg_5)
move_2 = Move(Geometry=item, Motion=Y)  # -> Geometry, Transform
move_3 = Move(Geometry=item_4, Motion=Y_2)  # -> Geometry, Transform
move_4 = Move(Geometry=item_2, Motion=Y_3)  # -> Geometry, Transform
division = Division(A=Slider(50, range=0..100), B=Slider(100, range=0..100))
move_5 = Move(Geometry=item_3, Motion=Y_4)  # -> Geometry, Transform
area = Area(Geometry=move_2.Geometry)  # -> Area, Centroid
move_6 = Move(Geometry=item_5, Motion=Y_5)  # -> Geometry, Transform
division_2 = Division(A=Slider(73, range=0..100), B=Slider(100, range=0..100))
area_2 = Area(Geometry=move_3.Geometry)  # -> Area, Centroid
division_3 = Division(A=Slider(100, range=0..100), B=Slider(70, range=0..100))
area_3 = Area(Geometry=move_4.Geometry)  # -> Area, Centroid
division_4 = Division(A=Slider(100, range=0..100), B=Slider(70, range=0..100))
area_4 = Area(Geometry=move_5.Geometry)  # -> Area, Centroid
division_5 = Division(A=Slider(100, range=0..100), B=Slider(100, range=0..100))
area_5 = Area(Geometry=move_6.Geometry)  # -> Area, Centroid
scale = Scale(Geometry=move_2.Geometry, Center=area.Centroid, Factor=division)  # -> Geometry, Transform
scale_2 = Scale(Geometry=move_3.Geometry, Center=area_2.Centroid, Factor=division_2)  # -> Geometry, Transform
scale_3 = Scale(Geometry=move_4.Geometry, Center=area_3.Centroid, Factor=division_3)  # -> Geometry, Transform
scale_4 = Scale(Geometry=move_5.Geometry, Center=area_4.Centroid, Factor=division_4)  # -> Geometry, Transform
scale_5 = Scale(Geometry=move_6.Geometry, Center=area_5.Centroid, Factor=division_5)  # -> Geometry, Transform
loft = Loft(
    Curves=[scale.Geometry, scale_2.Geometry, scale_3.Geometry, scale_4.Geometry, scale_5.Geometry],
    Options={Adjust=False, Closed=False, LoftEnds=0, LoftSimp=0, LoftType=0, Rebuild=10, Refit=0.01})
X_2 = UnitX(Factor=1)
contour = Contour(Shape=loft, Point=Point(0, 0, 0), Direction=X_2, Distance=Slider(2, range=0..10))
join = JoinCurves(Curves=contour, Preserve=False)
boundary = BoundarySurfaces(Edges=join)
X_3 = UnitX(Factor=Slider(1, range=0..1))
extr = Extrude(Base=boundary, Direction=X_3)
